# Grasshopper definition VariableOffset.gh (Grasshopper 1.0.8)
# plug-ins: VariableOffset

# Variable Offset
# WWW.LANDARCHTOOLS.COM
# INFO@LANDARCHTOOLS.COM
# V1.00
number_slider = Slider(11, range=0..100)
arrrec = RectangularArray(
    Geometry=Point(0, 0, 0),
    Cell={Plane=PlaneXY(1.483385607, 2.515016352, 0), Size=Domain2(u=-0.5..0.5, v=-0.5..0.5)},
    XCount=number_slider,
    YCount=number_slider)  # -> Geometry, Transform
lng = ListLength(List=arrrec.Geometry)
random = Random(Range=Domain(3, 9), Number=lng, Seed=2)

# ---- group: Number of Polygons
panel = Panel(lng)

# ----
int = Integer(random)
polygon = Polygon(Plane=arrrec.Geometry, Radius=0.5, Segments=int, FilletRadius=0)  # -> Polygon, Length
random_2 = Random(Range=Domain(0, 0.1), Number=int, Seed=2)
graft = GraftTree(Tree=polygon.Polygon, IncludeEmptyLists=True, IncludeNullItems=True)
neg = Negative(Value=random_2)
preview = CustomPreview(Geometry=polygon.Polygon, Material=ColourSwatch(SwatchColor=RGB(176, 176, 176)))
edgeoffset = VariableEdgeOffset(Curve=graft, EdgeOffsets=neg)
preview_2 = CustomPreview(Geometry=edgeoffset, Material=ColourSwatch(SwatchColor=RGB(255, 0, 170)))
